# Grasshopper definition UDP test.gh (Grasshopper 1.0.7)
# plug-ins: gHowl

udp = UDPReceiver(Address="127.0.0.1", Port="5000", Pattern=0)  # -> Info, Data
panel = Panel(udp.Data)
split = TextSplit(Text=panel, Separators=",")
panel_2 = Panel(split)
item = ListItem(List=panel_2, Index=0, Wrap=True)  # -> Item, Item1, Item2, Item3, Item4
xy = XYPlane(Origin=Point(0, 0, 0))
subtraction = Subtraction(A=item.Item1, B=item.Item4)
pt = ConstructPoint(XCoordinate=item.Item3, YCoordinate=subtraction, ZCoordinate=0)
rectangle = Rectangle(Plane=xy, XSize=item.Item, YSize=item.Item1, Radius=0)  # -> Rectangle, Length
rec = DataRecorder(pt, DataLimit=30, RecordData=True)  # disabled
intcrv = Interpolate(Vertices=rec, Degree=3, Periodic=False, KnotStyle=1)  # -> Curve, Length, Domain; disabled
cir = Circle(Plane=pt, Radius=item.Item2)
number_slider = Slider(40, range=0..100)
division = Division(A=item.Item, B=item.Item1)
seam = Seam(Curve=reparameterize(cir), Seam=Slider(0.25, range=0..1))
multiplication = Multiplication(A=division, B=number_slider)
len = Length(Curve=seam)
division_2 = Division(A=len, B=Slider(80, range=0..100))
addition = Addition(A=division_2, B="1")
sdivide = DivideSurface(Surface=rectangle.Rectangle, UCount=multiplication, VCount=number_slider)  # -> flatten(Points), Normals, Parameters
divide = DivideCurve(Curve=seam, Count=addition, Kinks=False)  # -> Points, Tangents, Parameters
item_2 = ListItem(List=sdivide.Points, Index=0, Wrap=True)  # -> Item, Item1
pull = PullPoint(Point=sdivide.Points, Geometry=seam, ClosestOnly=True)  # -> ClosestPoint, Distance
dist = Distance(PointA=item_2.Item, PointB=item_2.Item1)
division_3 = Division(A=dist, B="2")
sort = SortList(Keys=pull.Distance)  # -> reverse(Keys), ValuesA
item_3 = ListItem(List=sort.Keys, Index=0, Wrap=True)
multiplication_2 = Multiplication(A=item_3, B=Slider(0.248, range=0..1))
min = Minimum(A=pull.Distance, B=multiplication_2)
bnd = Bounds(Numbers=min)
remap = RemapNumbers(Value=min, Source=bnd, Target=Domain(0, 1))  # -> Mapped, Clipped
graph = GraphMapper(remap.Mapped, x0=0, x1=1, y0=0, y1=1, container_name="Bezier", cpx=[0, 0.5150181651, 0.5362018347, 1], cpy=[0, 0, 1, 1])
multiplication_3 = Multiplication(A=division_3, B=Slider(0.271, range=0..1))
multiplication_4 = Multiplication(A=division_3, B=Slider(1, range=0..1))
dom = ConstructDomain(DomainStart=multiplication_3, DomainEnd=multiplication_4)
remap_2 = RemapNumbers(Value=graph, Source=Domain(0, 1), Target=dom)  # -> Mapped, Clipped
neg = Negative(Value=remap_2.Mapped)
dom_2 = ConstructDomain(DomainStart=neg, DomainEnd=remap_2.Mapped)
rectangle_2 = Rectangle(Plane=sdivide.Points, XSize=dom_2, YSize=dom_2, Radius=0)  # -> Rectangle, Length
preview = CustomPreview(Geometry=rectangle_2.Rectangle, Material=ColourSwatch(SwatchColor=RGB(255, 255, 255)))
